# Grasshopper definition JSON Example.ghx (Grasshopper 0.9.70)
# plug-ins: ghJSON

child = GetChild(Parent="$", ObjectName="store")
child_2 = GetChild(Parent=child, ObjectName="book")
all = AllElements(Collection=child_2)
child_3 = GetChild(Parent=all, ObjectName="title")
panel = Panel("""{ "store": {
    "book": [ 
      { "category": "reference",
        "author": "Nigel Rees",
        "title": "Sayings of the Century",
        "price": 8.95
      },
      { "category": "fiction",
        "author": "Evelyn Waugh",
        "title": "Sword of Honour",
        "price": 12.99
      },
      { "category": "fiction",
        "author": "Herman Melville",
        "title": "Moby Dick",
        "isbn": "0-553-21311-3",
        "price": 8.99
      },
      { "category": "fiction",
        "author": "J. R. R. Tolkien",
        "title": "The Lord of the Rings",
        "isbn": "0-395-19395-8",
        "price": 22.99
      }
    ],
    "bicycle": {
      "color": "red",
      "price": 19.95
    }
  }
}""")
child_4 = GetChild(Parent="$", ObjectName="store")
allchldrn = GetAllChildren(Parent=child_4)
fromjson = FromJSON(JSON=panel)
element = GetElement(C=allchldrn, I="0")
panel_2 = Panel(element)
jpath = JPath(JObject=fromjson, JPathQuery=panel_2)
panel_3 = Panel(fromjson)
panel_4 = Panel(jpath)
